# Grasshopper definition flockSimulation01.gh (Grasshopper 1.0.7)
# plug-ins: termitesABMStoolkitAlpha

number_slider = Slider(100, range=0..100)
ghc_create2denvironment = GHC_Create2dEnvironment(BasePLane=PlaneXY(0, 0, 0), Width=number_slider, Height=number_slider)
neighboorhood_radius = Slider(6.968, range=1..10)

pt = Point(<point referenced from the Rhino model>)
pt_2 = Point(<point referenced from the Rhino model>)
circle = CircleCNR(Center=pt, Normal=Vector(0, 0, 1), Radius=Slider(7.603, range=0..100))
circle_2 = CircleCNR(Center=pt_2, Normal=Vector(0, 0, 1), Radius=Slider(24.711, range=0..100))

alignment_strength = Slider(9.317, range=0..15)
cohesion_strength = Slider(0, range=0..30)
separation_strength = Slider(30, range=0..30)
separation_distance = Slider(5.182, range=0.1..10)
panel = Panel("C:\Users\evang\OneDrive\Documents\GitHub\termitesABMS_toolkitAlpha\testFiles\")
reset = Button()
agent_count = Slider(181, range=1..1000)
play = BooleanToggle(False)
_3d = BooleanToggle(True)
use_r_tree = BooleanToggle(False)
useparallel = BooleanToggle(True)
hello_termites = HelloTermites(NewProjectFilePath=panel)  # -> NewProjectFilePath, Info, DefaultProjectFilePath
ghc_displayagentenvironment = GHC_DisplayAgentEnvironment(AgentEnvironment=ghc_create2denvironment)
ghc_flockingsimulation = GHC_flockingSimulation(
    Reset=reset,
    Play=play,
    Environment=ghc_create2denvironment,
    IsSimulation3D=_3d,
    Count=agent_count,
    Timestep=Slider(0.48, range=0..1),
    NeighbourhoodRadius=neighboorhood_radius,
    Alignment=alignment_strength,
    Cohesion=cohesion_strength,
    Separation=separation_strength,
    SeparationDistance=separation_distance,
    UseCoresInParallel=useparallel,
    UseRTreeSearch=use_r_tree)  # -> Info, Positions, Velocities
ghc_flockingsimulation_2 = GHC_flockingSimulation(
    Reset=reset,
    Play=play,
    Environment=ghc_create2denvironment,
    IsSimulation3D=agent_count,
    Count=10,
    Timestep=0.01,
    NeighbourhoodRadius=10,
    Alignment=1,
    Cohesion=1,
    Separation=1,
    SeparationDistance=5,
    UseCoresInParallel=True,
    UseRTreeSearch=True)  # -> Info, Positions, Velocities
panel_2 = Panel(hello_termites.NewProjectFilePath)
panel_3 = Panel(hello_termites.Info)
unit_vector = UnitVector(Vector=ghc_flockingsimulation.Velocities)
multiplication = Multiplication(A=unit_vector, B=Slider(9.706, range=0..10))
sphere = Sphere(Base=PlaneXY(0, 0, 0), Radius=Slider(0.25, range=0..1))
vector_display = VectorDisplay()
vector_display_ex = VectorDisplayEx(
    Point=ghc_flockingsimulation.Positions,
    Vector=multiplication,
    Colour=ColourSwatch(SwatchColor=RGB(0, 178, 255)),
    Width=2)
