# Grasshopper definition flockSimulation02.gh (Grasshopper 1.0.7)
# plug-ins: Kangaroo Components, LunchBox, termitesABMStoolkitAlphaR5, Kangaroo2 Components

number_slider = Slider(551.897, range=0..1500)
separation_distance = Slider(11.885, range=0.1..109)
division = Division(A=number_slider, B=2)
separation_distance_2 = Slider(5.182, range=0.1..10)
neighboorhood_radius = Slider(10, range=1..10)

pt = Point(<point referenced from the Rhino model>)
pt_2 = Point(Point(161.3443732, 244.5776421, 0))
circle = CircleCNR(Center=pt, Normal=Vector(0, 0, 1), Radius=Slider(100, range=0..100))
circle_2 = CircleCNR(Center=pt_2, Normal=Vector(0, 0, 1), Radius=Slider(100, range=0..100))

alignment_strength = Slider(121.93, range=0..185)
separation_strength = Slider(455.639, range=0..1940)
cohesion_strength = Slider(4.53, range=0..30)
reset = Button()
create_3d = GHC_Create3dGenericEnvironment(BasePLane=PlaneXY(0, 0, 0), Width=number_slider, Height=number_slider, Depth=number_slider)
tim = Slider(0.582, range=0..1)
agent_count = Slider(100, range=1..1000)
play = BooleanToggle(False)
_3d = BooleanToggle(False)
ghc_displayagentenvironment = GHC_DisplayAgentEnvironment(AgentEnvironment=create_3d)
use_r_tree = BooleanToggle(False)
useparallel = BooleanToggle(True)
Y = UnitY(Factor=division)
X = UnitX(Factor=division)
hello_termites = HelloTermites(NewProjectFilePath="C:\Users\Evangelos\Documents\GitHub\cicadaToolkit\")  # -> NewProjectFilePath, Info, DefaultProjectFilePath
number_slider_2 = Slider(6.351, range=0..124)
multiplication = Multiplication(A=number_slider_2, B=separation_distance)
division_2 = Division(A=number_slider_2, B=neighboorhood_radius)
move = Move(Geometry=ghc_displayagentenvironment, Motion=X)  # -> Geometry, Transform
ghc_flockingsimulation = GHC_flockingSimulation(
    Reset=reset,
    Play=play,
    Environment=create_3d,
    IsSimulation3D=_3d,
    Count=agent_count,
    Timestep=tim,
    NeighbourhoodRadius=division_2,
    Alignment=alignment_strength,
    Cohesion=cohesion_strength,
    Separation=separation_strength,
    SeparationDistance=multiplication,
    Repellers=[circle_2, circle],
    UseCoresInParallel=useparallel,
    UseRTreeSearch=use_r_tree)  # -> Info, Positions, Velocities
move_2 = Move(Geometry=move.Geometry, Motion=Y)  # -> Geometry, Transform
number_slider_3 = Slider(5, range=0..5)
panel = Panel(hello_termites.NewProjectFilePath)
panel_2 = Panel(hello_termites.Info)
gravity = Gravity(F=-9.8)
shift = ShiftList(List=ghc_flockingsimulation.Positions, Shift=number_slider_3, Wrap=True)
unit_vector = UnitVector(Vector=ghc_flockingsimulation.Velocities)
Z = UnitZ(Factor=Slider(8.468, range=0..10))
preview = CustomPreview(Geometry=move_2.Geometry, Material=ColourSwatch(SwatchColor=RGB(128, 128, 128)))
ln = Line(StartPoint=ghc_flockingsimulation.Positions, EndPoint=shift)  # -> flatten(Line)
floor = Floor(Strength=1)
kangaroo_settings = KangarooSettings(
    Tolerance=0.001,
    TimeStep=0.01,
    SubIterations=10,
    Floor=False,
    Drag=1,
    Restitution=0.7,
    StaticFriction=10,
    KineticFriction=10,
    Settle=2,
    Tumble=1,
    Sound=False,
    Solver=0)
load = Load(Point=ghc_flockingsimulation.Positions, ForceVector=Z)
vector_display_ex = VectorDisplayEx(Point=ghc_flockingsimulation.Positions, Vector=unit_vector, Colour=ColourSwatch(SwatchColor=RGB(0, 178, 255)), Width=2)
len = Length(Curve=ln)
sphere = Sphere(Base=PlaneXY(0, 0, 0), Radius=number_slider_2)
timer = Timer(TimerInterval=100, Target=springs)
box = CenterBox(Base=ghc_flockingsimulation.Positions, X=number_slider_2, Y=number_slider_2, Z=1)
springs = SpringsFromLine(
    Connection=ln,
    Stiffness=Slider(493, range=1..1000),
    Damping=Slider(9.706, range=0..10),
    RestLength=number_slider_2,
    UpperCutoff=0,
    LowerCutoff=0,
    Plasticity=0)
larger = LargerThan(FirstNumber=len, SecondNumber=Slider(690, range=1..1000))  # -> LargerThan, OrEqualTo

swatch = ColourSwatch(SwatchColor=RGB(255, 0, 0))
crv = Curve(ln)
concat = Concatenate(FragmentA="agentLines", FragmentB=Slider(3, range=0..10))
bake = ObjectBake(
    BakeToggle=Button(),
    GeometryObjects=flatten(crv),
    Layer=concat,
    ObjectName="GH_Obj",
    ObjectColor=swatch,
    LayerColor=swatch)

cull = CullPattern(List=ln, CullPattern=larger.LargerThan)
kangaroo = KangarooPhysics(ForceObjects=flatten(springs), Settings=kangaroo_settings, SimulationReset=reset)  # -> Out, Iterations, ParticlesOut, GeometryOut, KE
sg = SoapFilm(Strength=1)
shift_2 = ShiftList(List=kangaroo.ParticlesOut, Shift=number_slider_3, Wrap=True)
ln_2 = Line(StartPoint=kangaroo.ParticlesOut, EndPoint=shift_2)  # -> flatten(Line)

# ==== cluster Gravity: Apply gravity to vertices of a mesh
M = ClusterInput()
F = ClusterInput()
mcomp = Decompose(Mesh=M)  # -> Vertices, Faces, Colours, Normals
Z = UnitZ(Factor=F)
duppt = RemoveDuplicatePts(Points=mcomp.Vertices, Tolerance=0.01)
uforce = UnaryForce(Point=duppt, Force=Z)
U = ClusterOutput(uforce)
