# Grasshopper definition testHello.gh (Grasshopper 0.9.76)
# plug-ins: termitesABMStoolkitAlphaR5

panel = Panel("C:\Users\Evangelos\Documents\GitHub\termitesABMS_toolkit\termitesABMS_toolkitAlpha_r5\testFiles\")
file_path = FilePath("C:\Users\evang\OneDrive\Desktop\190125_DoLAB\")
hello = HelloTermites(NewProjectFilePath=panel)  # -> NewProjectFilePath, Info, DefaultProjectFilePath
hello_termites = HelloTermites(NewProjectFilePath=panel)  # -> NewProjectFilePath, Info, DefaultProjectFilePath
hello_termites_2 = HelloTermites()  # -> NewProjectFilePath, Info, DefaultProjectFilePath
systemsetup = SystemSetup(ProjectFolderFilePath=file_path, NoOfOutputs=Slider(4, range=0..4))  # -> ProjectFolderFilePath, NoOfOutputs, Info
panel_2 = Panel(systemsetup.ProjectFolderFilePath)
panel_3 = Panel(systemsetup.NoOfOutputs)
panel_4 = Panel(systemsetup.Info)
panel_5 = Panel(hello_termites_2.NewProjectFilePath)
panel_6 = Panel(hello_termites.NewProjectFilePath)
panel_7 = Panel(hello_termites.Info)
